# Grasshopper definition ger_bridging_ginger.ghx (Grasshopper 1.0.8)
# plug-ins: opennest_2 Info, LunchBox

# Base Box
origin_point = Point(Point(0, 0, 0))
base_box_width_x = Slider(100, range=0..1000)
base_box_length_y = Slider(100, range=0..1000)
base_box_height_z = Slider(1.4, range=0..3)
bridge_foot_y = Slider(15, range=0..20)
number_of_bridges = Slider(3, range=0..20)
height_under_bridge = Slider(30, range=0..50)
height_of_bridge = Slider(15, range=0..20)
slice_distance_c2c = Slider(3, range=0..10)
bake = Button()
bridge_foot_x = Slider(15, range=0..20)
# 1.05mm Min for 3.0 Nozzle!
slice_thickness = Slider(1.1, range=0..2.5)
number_slider = Slider(0, range=0..100)
_2 = Integer(2)
addition = Addition(A=base_box_height_z, B=height_under_bridge)
multiplication = Multiplication(A=bridge_foot_x, B=_2)
subtraction = Subtraction(A=base_box_length_y, B=bridge_foot_y)
addition_2 = Addition(A=addition, B=height_of_bridge)
subtraction_2 = Subtraction(A=base_box_width_x, B=multiplication)
range = Range(Domain=subtraction, Steps=number_of_bridges)
eval = Evaluate(E="x+y", x=base_box_width_x, y=number_slider)
eval_2 = Evaluate(E="x+(y/2)", x=range, y=bridge_foot_y)
eval_3 = Evaluate(E="x+(y/2)", x=base_box_width_x, y=number_slider)
range_2 = Range(Domain=subtraction_2, Steps=expr("x+1", number_of_bridges))
Y = UnitY(Factor=range)
_1 = Integer(1)
addition_3 = Addition(A=eval_3, B=Slider(35, range=0..100))
X = UnitX(Factor=addition_3)
pt = ConstructPoint(XCoordinate=X, YCoordinate=eval_2, ZCoordinate=0)
division = Division(A=bridge_foot_y, B=2)
split = SplitList(List=range_2, Index=_1)  # -> ListA, ListB
move = Move(Geometry=origin_point, Motion=Y)  # -> Geometry, Transform
X_2 = UnitX(Factor=bridge_foot_x)
text = Text(Location=pt, Text=split.ListB, Size=division)
addition_4 = Addition(A=split.ListB, B=multiplication)
move_2 = Move(Geometry=move.Geometry, Motion=X_2)  # -> Geometry, Transform
rectangle = Rectangle(Plane=move_2.Geometry, XSize=split.ListB, YSize=addition, Radius=0)  # -> Rectangle, Length
rectangle_2 = Rectangle(Plane=move.Geometry, XSize=addition_4, YSize=addition_2, Radius=0)  # -> Rectangle, Length
X_3 = UnitX(Factor=1)
rot3d = Rotate3D(Geometry=rectangle.Rectangle, Angle=1.570796327, Center=move.Geometry, Axis=X_3)  # -> Geometry, Transform
rot3d_2 = Rotate3D(Geometry=rectangle_2.Rectangle, Angle=1.570796327, Center=move.Geometry, Axis=X_3)  # -> Geometry, Transform
xz = XZPlane(Origin=move.Geometry)
rdiff = RegionDifference(CurvesA=graft(rot3d_2.Geometry), CurvesB=graft(rot3d.Geometry), Plane=graft(xz))
Y_2 = UnitY(Factor=bridge_foot_y)
extr = Extrude(Base=rdiff, Direction=Y_2)
rectangle_3 = Rectangle(Plane=PlaneXY(0, 0, 0), XSize=eval, YSize=base_box_length_y, Radius=0)  # -> Rectangle, Length
cap = CapHoles(Brep=extr)
Y_3 = UnitY(Factor=1)
boxrec = BoxRectangle(Rectangle=rectangle_3.Rectangle, Height=base_box_height_z)
box = Box({Plane=PlaneXY(0, 0, 0), X=Domain(0, 30), Y=Domain(0, 95), Z=Domain(0, 5)})
Y_4 = UnitY(Factor=slice_thickness)
contour = Contour(Shape=graft(cap), Point=graft(move.Geometry), Direction=Y_3, Distance=slice_distance_c2c)  # -> flatten(Contours)
extr_2 = Extrude(Base=contour, Direction=Y_4)
cap_2 = CapHoles(Brep=extr_2)
sunion = SolidUnion(Breps=[cap_2, boxrec])
bake_2 = ObjectBake(
    BakeToggle=bake,
    GeometryObjects=sunion,
    Layer="GH_Bake",
    ObjectName="GH_Obj",
    ObjectColor=RGB(255, 254, 255),
    LayerColor=RGB(255, 254, 255))
